# Grasshopper definition example.gh (Grasshopper 1.0.7)
# plug-ins: HAL for Grasshopper, ARCS

sessionsettings = SessionSettings()

# ---- group: Generate spray paths
target_surface = Surface(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)
top_surface = Surface(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)
arcs_extendsurf = ExtendSurface(Surf=target_surface, Plane=PlaneYZ(0, 0, 0))
number_slider = Slider(700, range=0..1000)
number_slider_2 = Slider(-12.5, range=-100..0)
arcs_sprayinner = SprayInnerPaths(
    Surf=target_surface,
    ExtSurf=arcs_extendsurf,
    TopSurf=top_surface,
    Speeds=Slider(350, range=0..1000),
    ConnSpeed=number_slider,
    FlowRate=Slider(100000, range=0..100000),
    Dist=Slider(50, range=0..100),
    ExpandDist=number_slider_2,
    NumGeo=20,
    PathRepeat=1,
    ThicknessFactor=1)  # -> SprayPath, Thicknesses, Slices
arcs_spraypath = SprayPath(arcs_sprayinner.SprayPath)
brep = Brep(arcs_sprayinner.Slices)

# ---- group: Add starting point
starting_point = Panel("{1000,1000,0}")
pt = Point(starting_point)
merge = Merge(Data1=flatten(pt), Data2=flatten(arcs_spraypath), Data3=flatten(pt))
acorn_connectboundary = ConnectGeometriesThroughBoundary(
    Paths=merge,
    ConnSpeed=number_slider,
    Surf=target_surface,
    ExtSurf=arcs_extendsurf,
    ExpandDist=number_slider_2,
    MaintainDir=False,
    KeepConn=True)

# ---- group: Extract targets for HAL robotics
arcs_extract = ExtractTargets(
    SprayPath=acorn_connectboundary,
    Surf=target_surface,
    EdgeDist=Slider(0, range=0..100),
    EdgeAngle=Slider(0, range=0..100),
    TolD=10,
    TolA=10,
    SafeSpeed=300)  # -> Targets, Normals, Speeds
