# Grasshopper definition example_gh_components.gh (Grasshopper 1.0.7)
# plug-ins: HAL for Grasshopper, AcornSpraying

sessionsettings = SessionSettings()

# ---- group: Test surfaces
sphere_segment = Geometry(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)
_3d_scan_segment = Surface(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)

# ----
# Waste basket in the table's reference space.
waste_basket_location_to_table_reference = Panel("""2000
1000
0""")
num2pt = NumbersToPoints(Numbers=waste_basket_location_to_table_reference, Mask=4)
waste_basket_point = Point(num2pt)
tag = TextTag(Location=num2pt, Text="Waste basket")

# ----
# Point location of the table's reference in world space.
table_reference_point = Panel("""0
0
0""")
num2pt_2 = NumbersToPoints(Numbers=table_reference_point, Mask=4)
table_reference_point_2 = Point(num2pt_2)

# ----
# Angle to start geodesic curves.
angle = Slider(0, range=0..45)
num_paths = Slider(4, range=1..10)

# ----
# Settings
# Surface in the table's reference space.
surface = Surface(sphere_segment)

# ---- group: Robot settings
spray_blend_angle = Slider(5, range=0..30)
spray_speed_on_surf = Slider(200, range=0..500)
wait_time = Slider(3, range=0..60)
export_directory_override = Panel("")
target_dist_filter = Slider(10, range=0..100)
spray_speed_off_surf = Slider(500, range=0..500)
spray_blend_dist = Slider(10, range=0..100)
py_exdir = GhPythonScript(path=export_directory_override)  # -> export_directory
# ---------- py_exdir: Python ----------
import os

if (os.path.isdir(path)):
    export_directory = path
else:
    export_directory = ghenv.Component.OnPingDocument().FilePath
    
    if (export_directory is None):
        export_directory = os.path.join(os.environ["HOMEPATH"], "Desktop")
    else:
        export_directory = os.path.dirname(export_directory)
# ---------- end py_exdir ----------
panel = Panel(py_exdir)

# ---- group: Generate extended surface
plane_angle = Number(angle)
# Generate spraying path from surface
surf = Surface(surface)
yz = YZPlane(Origin=Point(0, 0, 0))
rotate = Rotate(Geometry=yz, Angle=plane_angle, Plane=PlaneXY(0, 0, 0))  # -> Geometry, Transform
acorn_extendsurf = ExtendSurf(Surf=surf, Plane=rotate.Geometry)
extended_surf = Surface(acorn_extendsurf)

# ---- group: Table reference point
table_reference_point_3 = Point(table_reference_point_2)
panel_2 = Panel("tableRef")
reference = CreateReference(
    Alias=panel_2,
    Frame=table_reference_point_3,
    _0_0=panel_2,
    _1_0=table_reference_point_3,
    Mode=0,
    RunInBackground=False,
    nickName="Reference")
tablereference = TableReference(reference, isNickNameImplied=False)

# ---- group: Wait
wait_time_2 = Number(wait_time)
panel_3 = Panel("wait")
waittime = WaitTime(Alias=panel_3, DurationS=wait_time_2, _0_0=panel_3, _1_0=wait_time_2, Mode=0, RunInBackground=False, nickName="WaitTime")

# ----
panel_4 = Panel("goSpray")
panel_5 = Panel("SprayMod")

# ---- group: Spray geometry settings
overspray_dist = Slider(-100, range=-300..300)
overlap_ratio = Slider(0, range=0..100)
use_scanned_spray_circle = BooleanToggle(False)

# ---- group: Inputs
surf_2 = Surface(surface)
angle_2 = Number(angle)
num_paths_2 = Number(num_paths)
overspray_dist_2 = Number(overspray_dist)

# ----
py_pathang = GhPythonScript(angle=angle_2, num_paths=num_paths_2)  # -> angles
# ---------- py_pathang: Python ----------
if (num_paths <= 1):
    angles = angle
else:
    angles = []
    for i in range(0, int(num_paths)):
        x = i * 90 / (num_paths - 1)
        angles.append(angle + x)
# ---------- end py_pathang ----------

# ---- group: Inputs (continued)
rad = Radians(Degrees=py_pathang)

# ---- group: Connect all points of interest
# Visualise spraying
overspray_distance = Number(overspray_dist)
waste_basket_point_2 = Point(waste_basket_point)
surf_3 = Surface(surface)
extended_surf_2 = Surface(extended_surf)

# ----
surf_4 = Surface(surface)

# ---- group: Separate spray paths
surf_5 = Surface(surface)
extended_surf_3 = Surface(extended_surf)

# ----
# Visualise waste
surf_6 = Surface(surface)

# ---- group: Tool creation
# Define robot
use_scanned_spray_circle_2 = Boolean(use_scanned_spray_circle)
theoretical_spray_circle = Circle({Plane=PlaneXZ(0, -451.1750694, 79.1), Radius=93.15463234})
_3d_scan_spray_circle = Circle({Plane=PlaneXZ(0, -451.1750694, 79.1), Radius=123.5315211})
spray_gun_outlet = Circle({Plane=PlaneXZ(0, -141.1750694, 79.1), Radius=8.5})
weave = Weave(Pattern=use_scanned_spray_circle_2, Stream0=theoretical_spray_circle, Stream1=_3d_scan_spray_circle, NullGaps=False)
end_of_cone = Point(Point(0, -451.1750694, 79.1))
rulesrf = RuledSurface(CurveA=weave, CurveB=spray_gun_outlet)
spray_gun_mesh = Geometry([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])
yz_2 = YZPlane(Origin=end_of_cone)
rotate_2 = Rotate(Geometry=yz_2, Angle=-1.570796327, Plane=end_of_cone)  # -> Geometry, Transform
tool_frame = Plane(rotate_2.Geometry)

# ---- group: Spray geometry settings (continued)
py_dia = GhPythonScript(circle=weave)  # -> diameter
# ---------- py_dia: Python ----------
__author__ = "Mishael Nuh"
__version__ = "2021.03.02"

import rhinoscriptsyntax as rs

diameter = circle.Radius * 2
# ---------- end py_dia ----------
expression = Expression(d=py_dia, o=overlap_ratio, Expression="d*(1-o/100)")

# ---- group: Inputs (continued)
dist = Number(expression)
acorn_spray = SprayPath(Surf=surf_2, Extended_surf=extended_surf, Angle=rad, Dist=dist, Overspray_dist=overspray_dist_2)

# ----
spray_diameter = Number(py_dia)
path = Curve(acorn_spray)
acorn_vzspraycirc = VisualiseSprayCircles(Surf=surf_4, Path=path, Spray_diameter=spray_diameter)

# ---- group: Connect all points of interest (continued)
merge = Merge(Data1=flatten(waste_basket_point_2), Data2=flatten(acorn_spray), Data3=flatten(waste_basket_point_2))  # -> flatten(Result)
acorn_connect = ConnectPathsThroughBounds(Geometries=merge, Surf=surf_3, Extended_surf=extended_surf_2, Overspray_dist=overspray_distance)
paths = Geometry(acorn_connect)

# ---- group: Separate spray paths (continued)
spray_diameter_2 = Number(py_dia)
acorn_splitpathsurf = SplitPathsOffOnSurf(Path=paths, Surf=surf_5, Extended_surf=extended_surf_3, Spray_diameter=spray_diameter_2)  # -> Paths, On_surface
on_surface = Boolean(flatten(acorn_splitpathsurf.On_surface))
paths_2 = Geometry(flatten(acorn_splitpathsurf.Paths))

# ----
on_surface_2 = Boolean(on_surface)
paths_3 = Geometry(paths_2)
acorn_vzspraycirc_2 = VisualiseWaste(Surf=surf_6, Path=paths_3, On_surface=on_surface_2)

cap = CapHoles(Brep=rulesrf)

# ---- group: Tool creation (continued)
merge_2 = Merge(Data1=flatten(spray_gun_mesh), Data2=flatten(cap))  # -> flatten(Result)
tool_geometry = Geometry(merge_2)

# ---- group: Sprayer tool
xy = XYPlane(Origin=Point(0, 0, 0))
rotate_3 = Rotate(Geometry=xy, Angle=-1.570796327, Plane=PlaneXY(0, 0, 0))  # -> Geometry, Transform
# Settings and reference
mesh_colour = Colour([RGB(33, 40, 173), RGB(33, 40, 173), RGB(33, 40, 173), RGB(156, 156, 156), RGB(214, 153, 92), RGB(214, 153, 92), RGB(214, 153, 92), RGB(214, 153, 92), RGB(240, 240, 240)])
panel_6 = Panel("sprayGun")
tool = Tool(
    Alias=panel_6,
    Frame=rotate_3.Geometry,
    Object_Body=tool_geometry,
    Object_Color=mesh_colour,
    ToolFrame=tool_frame,
    _0_0=panel_6,
    _1_0=rotate_3,
    _2_0=tool_geometry,
    _3_0=mesh_colour,
    _6_0=tool_frame,
    Mode=0,
    RunInBackground=False,
    nickName="Tool")

# ---- group: Robot
xy_2 = XYPlane(Origin=Point(0, 0, 0))
panel_7 = Panel("baseRobot")
robot = Robot(
    Alias=panel_7,
    Location=xy_2,
    _0_0=panel_7,
    _1_0=xy_2,
    Mode=0,
    RunInBackground=False,
    catalogItem="Mechanism,ce850552-3091-4db7-93ac-81867ea54116",
    nickName="⧉ Robot")
panel_8 = Panel("robot")
attach = Attach(
    Alias=panel_8,
    Parent=robot,
    Child=tool,
    IsEndEffector=True,
    InWorld=True,
    _0_0=panel_8,
    _1_0=robot,
    _2_0=tool,
    Mode=0,
    RunInBackground=False,
    nickName="Attach")
robot_2 = Robot(attach, isNickNameImplied=True)

# ---- group: Allow target rotation around Z axis
panel_9 = Panel("0")
panel_10 = Panel("2*Pi")
constraints = TargetConstraints(
    RotationAxis={halEnum=2, halEnumType="HAL.Spatial.Axis"},
    MinRotationRad=panel_9,
    MaxRotationRad=panel_10,
    _2_0=panel_9,
    _3_0=panel_10,
    Mode=0,
    RunInBackground=False,
    nickName="Constraints")
robot_3 = Robot(robot_2, isNickNameImplied=True)
kinematics = KinematicSettings(
    Mechanism=robot_3,
    TargetConstraints=constraints,
    _1_0=robot_3,
    _3_0=constraints,
    Mode=0,
    RunInBackground=False,
    nickName="Kinematics")

# ---- group: Spray settings
on_surface_3 = Boolean(on_surface)
spray_speed_off_surface = Number(spray_speed_off_surf)
spray_speed_on_surface = Number(spray_speed_on_surf)
spray_blend_dist_2 = Number(spray_blend_dist)
spray_blend_angle_2 = Number(spray_blend_angle)
panel_11 = Panel("speedOffSurf")
panel_12 = Panel("speedOnSurf")
speed = SpeedSettings(
    Alias=panel_11,
    PositionMmS=spray_speed_off_surface,
    _0_0=panel_11,
    _1_0=spray_speed_off_surface,
    Mode=0,
    RunInBackground=False,
    nickName="Speed")
speed_2 = SpeedSettings(
    Alias=panel_12,
    PositionMmS=spray_speed_on_surface,
    _0_0=panel_12,
    _1_0=spray_speed_on_surface,
    Mode=0,
    RunInBackground=False,
    nickName="Speed")
p_n_c = PickNChoose(Pattern=graft(on_surface_3), Stream0="sprayOffSet", Stream1="sprayOnSet")
rad_2 = Radians(Degrees=spray_blend_angle_2)
panel_13 = Panel("sprayBlend")
blend = BlendSettings(
    Alias=panel_13,
    PositionMm=spray_blend_dist_2,
    OrientationRad=rad_2,
    _0_0=panel_13,
    _1_0=spray_blend_dist_2,
    _2_0=rad_2,
    Mode=0,
    RunInBackground=False,
    nickName="Blend")
p_n_c_2 = PickNChoose(Pattern=graft(on_surface_3), Stream0=speed, Stream1=speed_2)
path_mapper = PathMapper(p_n_c, source="{a;b}", target="{a}")
path_mapper_2 = PathMapper(p_n_c_2, source="{a;b}", target="{a}")
motionsettings = MotionSettings(
    Alias=path_mapper,
    Space={halEnum=0, halEnumType="HAL.Motion.Settings.MotionSpace"},
    Speed=path_mapper_2,
    Blend=blend,
    Kinematics=kinematics,
    _0_0=path_mapper,
    _2_0=path_mapper_2,
    _4_0=blend,
    _5_0=kinematics,
    Mode=0,
    RunInBackground=False,
    nickName="MotionSettings")

# ---- group: Spray
target_distance_filter = Number(target_dist_filter)
surf_7 = Geometry(surface)
tablereference_2 = TableReference(tablereference, isNickNameImplied=True)
paths_4 = Curve(simplify(paths_2))
target = Target(
    Alias="Curve",
    Curve=paths_4,
    Discretization={halEnum=1, halEnumType="HAL.McNeel.RhinoCommon5.Spatial.CurveDiscretization"},
    ToleranceMm=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,
    Reference=tablereference_2,
    InWorld=False,
    _1_0=paths_4,
    _4_0=tablereference_2,
    Mode=0,
    RunInBackground=False,
    nickName="Target")  # -> simplify(Object_Target), Trace
lng = ListLength(List=target.Object_Target)
filter = TargetFilter(
    Object_Target=flatten(target.Object_Target),
    PositionMm=target_distance_filter,
    OrientationRad=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,
    _0_0=target,
    _1_0=target_distance_filter,
    Mode=0,
    RunInBackground=False,
    nickName="Filter")  # -> Object_Remaining, Object_Discarded, Object_Mask
evalsrf = EvaluateSurface(Surface=surf_7, Point="{0.5, 0.5, 0}")  # -> Point, Normal, UDirection, VDirection, Frame
Z = UnitZ(Factor=1)
repeat = RepeatData(Data=graft(motionsettings), Length=graft(lng))  # -> flatten(Data)
dprod = DotProduct(VectorA=Z, VectorB=evalsrf.Normal, Unitize=False)
cull = CullPattern(List=repeat, CullPattern=filter.Object_Mask)
larger = LargerThan(FirstNumber=dprod, SecondNumber=0)  # -> LargerThan, OrEqualTo
normal = Normal(
    Target=flatten(filter.Object_Remaining),
    Guide=flatten(surf_7),
    Axis={halEnum=2, halEnumType="HAL.Spatial.Axis"},
    Flip=larger.LargerThan,
    Project=False,
    _0_0=filter,
    _2_0=surf_7,
    _4_0=larger,
    Mode=0,
    RunInBackground=False,
    nickName="Normal")  # -> simplify(Target), Object_OnGuide, Object_Normal
target_2 = TargetProperties(Target=normal.Target, _0_0=normal, Mode=0, RunInBackground=False, nickName="Target")  # -> Alias, Object_Joint, WayFrame, EndFrame, Reference, IsArc
vec2pt = Vector2Pt(PointA="{0,0,0}", PointB=target_2.EndFrame, Unitize=True)  # -> Vector, Length
parallel = Parallel(
    Target=normal.Target,
    Direction=vec2pt.Vector,
    Axis={halEnum=1, halEnumType="HAL.Spatial.Axis"},
    Flip=False,
    Project=True,
    _0_0=normal,
    _2_0=vec2pt,
    Mode=0,
    RunInBackground=False,
    nickName="Parallel")  # -> flatten(Target)
move = Move(
    Alias=panel_4,
    Object_Target=parallel,
    Object_MotionSettings=cull,
    _0_0=panel_4,
    _1_0=parallel,
    _2_0=cull,
    Mode=0,
    RunInBackground=False,
    nickName="Move")  # -> simplify(Action)

# ---- group: Move to waste basket
waste_basket_position = Point(waste_basket_point)
tablereference_3 = TableReference(tablereference, isNickNameImplied=True)
pflip = FlipPlane(Plane=waste_basket_position, ReverseX=False, ReverseY=False, SwapAxes=True)
panel_14 = Panel("wasteMoSet")
motionsettings_2 = MotionSettings(
    Alias=panel_14,
    Space={halEnum=1, halEnumType="HAL.Motion.Settings.MotionSpace"},
    Kinematics=kinematics,
    _0_0=panel_14,
    _5_0=kinematics,
    Mode=0,
    RunInBackground=False,
    nickName="MotionSettings")
panel_15 = Panel("wasteT")
target_3 = Target(
    Object_Alias=panel_15,
    Object_Frame=pflip,
    Reference=tablereference_3,
    InWorld=False,
    _0_0=panel_15,
    _1_0=pflip,
    _2_0=tablereference_3,
    Mode=0,
    RunInBackground=False,
    nickName="Target")
panel_16 = Panel("goWaste")
move_2 = Move(
    Alias=panel_16,
    Object_Target=target_3,
    Object_MotionSettings=motionsettings_2,
    _0_0=panel_16,
    _1_0=target_3,
    _2_0=motionsettings_2,
    Mode=0,
    RunInBackground=False,
    nickName="Move")

# ---- group: Move home
j1 = Slider(0, range=-180..180)
j2 = Slider(0, range=-70..85)
j3 = Slider(0, range=-28..110)
j4 = Slider(0, range=-300..300)
j5 = Slider(30, range=-120..120)
j6 = Slider(0, range=-300..300)
# Procedures
robot_4 = Robot(robot_2, isNickNameImplied=True)
angle_3 = Angle(j1, isNickNameImplied=False, locked=False, unit="deg")
angle_4 = Angle(j2, isNickNameImplied=False, locked=False, unit="deg")
angle_5 = Angle(j3, isNickNameImplied=False, locked=False, unit="deg")
angle_6 = Angle(j4, isNickNameImplied=False, locked=False, unit="deg")
angle_7 = Angle(j5, isNickNameImplied=False, locked=False, unit="deg")
angle_8 = Angle(j6, isNickNameImplied=False, locked=False, unit="deg")
angle_rad = Angle(angle_3, isNickNameImplied=True, locked=True, unit="rad")
angle_rad_2 = Angle(angle_4, isNickNameImplied=True, locked=True, unit="rad")
angle_rad_3 = Angle(angle_5, isNickNameImplied=True, locked=True, unit="rad")
angle_rad_4 = Angle(angle_6, isNickNameImplied=True, locked=True, unit="rad")
angle_rad_5 = Angle(angle_7, isNickNameImplied=True, locked=True, unit="rad")
angle_rad_6 = Angle(angle_8, isNickNameImplied=True, locked=True, unit="rad")
position = Merge(
    Data1=flatten(angle_rad),
    Data2=flatten(angle_rad_2),
    Data3=flatten(angle_rad_3),
    Data4=flatten(angle_rad_4),
    Data5=flatten(angle_rad_5),
    Data6=flatten(angle_rad_6))
panel_17 = Panel("homeMoSet")
motionsettings_3 = MotionSettings(
    Alias=panel_17,
    Space={halEnum=1, halEnumType="HAL.Motion.Settings.MotionSpace"},
    _0_0=panel_17,
    Mode=0,
    RunInBackground=False,
    nickName="MotionSettings")
panel_18 = Panel("homeT")
target_4 = Target(
    Alias=panel_18,
    Mechanism=robot_4,
    Object_Position=position,
    _0_0=panel_18,
    _1_0=robot_4,
    _2_0=position,
    Mode=0,
    RunInBackground=False,
    nickName="Target")
panel_19 = Panel("goHome")
move_3 = Move(
    Alias=panel_19,
    Object_Target=target_4,
    Object_MotionSettings=motionsettings_3,
    _0_0=panel_19,
    _1_0=target_4,
    _2_0=motionsettings_3,
    Mode=0,
    RunInBackground=False,
    nickName="Move")

# ----
merge_3 = Merge(
    Data1=flatten(move_3),
    Data2=flatten(move_2),
    Data3=flatten(waittime),
    Data4=flatten(move),
    Data5=flatten(waittime),
    Data6=flatten(move_3))
panel_20 = Panel(merge_3)
combine = CombineActions(
    Alias=panel_5,
    Object_Combined=merge_3,
    Compact=False,
    _0_0=panel_5,
    _1_0=merge_3,
    Mode=0,
    RunInBackground=False,
    nickName="Combine")

# ---- group: Solve robot
controller = ExecutionControl(Loop=False, TimeRatio=1)
solve = BooleanToggle(False)
export = BooleanToggle(False)
export_directory = Text(py_exdir)
# Solver
robot_5 = Robot(robot_2, isNickNameImplied=True)
panel_21 = Panel("controller")
controller_2 = Controller(
    Alias=panel_21,
    Object_Mechanism=robot_5,
    Object_Procedure=combine,
    _0_0=panel_21,
    _2_0=robot_5,
    _3_0=combine,
    Mode=0,
    RunInBackground=False,
    catalogItem="Controller,7ab5730a-2de3-481a-aaee-af392f24ce56",
    nickName="⧉ Controller")
solver = ProcedureSolver(Controller=controller_2, Solve=solve, Mode=0, RunInBackground=True)  # -> Solution, Object_Solved, Notification
execute = Execute(
    ExecutionControl=controller,
    Solution=solver.Solution,
    displayEnvironment=True,
    displayMechanisms=True,
    displayTrace=True)
export_2 = ExportProcedure(
    Controller=controller_2,
    Solution=solver.Solution,
    Destination=export_directory,
    Export=export,
    _0_0=controller_2,
    _1_0=solver,
    _2_0=export_directory,
    _3_0=export,
    Mode=0,
    RunInBackground=True,
    nickName="Export")

# ----
file = ReadFile(File=export_2, PerLineParse=True)
panel_22 = Panel(export_2)
panel_23 = Panel(file)
