# Grasshopper definition example_python_script.gh (Grasshopper 1.0.7)
# plug-ins: HAL for Grasshopper

sessionsettings = SessionSettings()

# ---- group: Test surfaces
sphere_segment = Geometry(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)
_3d_scan_segment = Surface(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)

# ----
# Waste basket in the table's reference space.
waste_basket_location_to_table_reference = Panel("""2000
1000
0""")
num2pt = NumbersToPoints(Numbers=waste_basket_location_to_table_reference, Mask=4)
waste_basket_point = Point(num2pt)
tag = TextTag(Location=num2pt, Text="Waste basket")

# ----
# Point location of the table's reference in world space.
table_reference_point = Panel("""0
0
0""")
num2pt_2 = NumbersToPoints(Numbers=table_reference_point, Mask=4)
table_reference_point_2 = Point(num2pt_2)

# ---- group: Robot settings
spray_blend_angle = Slider(5, range=0..30)
spray_speed_on_surf = Slider(50, range=0..500)
wait_time = Slider(3, range=0..60)
export_directory = Panel("\\Mac\Home\OneDrive - University of Cambridge\PhD Work\20201130 - Spraying HAL Code\20201215 - 3D Formwork Scan\20210104")
spray_speed_off_surf = Slider(500, range=0..500)
target_dist_filter = Slider(10, range=0..100)
spray_blend_dist = Slider(10, range=0..100)
spray_distance = Slider(300, range=0..500)

# ----
# Angle to start geodesic curves.
angle = Slider(45, range=0..45)

overlap_ratio = Slider(0, range=0..100)

# ---- group: Spray geometry settings
# Overspray should be greater than half of spray distance.
# Set as same seems to be safe.
spray_diameter = Slider(200, range=0..300)
overspray_dist = Slider(100, range=0..300)
expression = Expression(d=spray_diameter, o=overlap_ratio, Expression="d*(1-o/100)")

# ----
# Settings
# Surface in the table's reference space.
surface = Surface(sphere_segment)

# ---- group: Generate extended surface
plane_angle = Number(angle)
# Generate spraying path from surface
surf = Surface(surface)
yz = YZPlane(Origin=Point(0, 0, 0))
rotate = Rotate(Geometry=yz, Angle=plane_angle, Plane=PlaneXY(0, 0, 0))  # -> Geometry, Transform
extend_surf = GhPythonScript(surf=surf, plane=rotate.Geometry)  # -> extended_surf; inputs surf: Brep, plane: Plane
# ---------- extend_surf: Python ----------
from acorn_spraying.misc import extend_surf

extended_surf = extend_surf(surf, plane)
# ---------- end extend_surf ----------
extended_surf = Surface(extend_surf)

# ---- group: Inputs
surf_2 = Surface(surface)
angle_2 = Number(angle)
overspray_dist_2 = Number(overspray_dist)
dist = Number(expression)
addition = Addition(A=angle_2, B=Slider(90, range=0..100))
merge = Merge(Data1=angle_2, Data2=addition)
rad = Radians(Degrees=merge)
spray_paths = GhPythonScript(surf=surf_2, extended_surf=extended_surf, angle=rad, dist=dist, overspray_dist=overspray_dist_2)  # -> path; inputs surf: Brep, extended_surf: Surface
# ---------- spray_paths: Python ----------
from acorn_spraying.path_generation import spray_path

path = spray_path(surf, extended_surf, angle, dist, overspray_dist)
# ---------- end spray_paths ----------
item = ListItem(List=spray_paths, Index=0, Wrap=True)  # -> Item, Item1
path_1 = Curve(item.Item)
path_2 = Curve(item.Item1)

# ---- group: Connect all points of interest
waste_basket_point_2 = Point(waste_basket_point)
overspray_distance = Number(overspray_dist)
surf_3 = Surface(surface)
extended_surf_2 = Surface(extended_surf)
merge_2 = Merge(Data1=flatten(waste_basket_point_2), Data2=flatten(path_1), Data3=flatten(path_2), Data4=flatten(waste_basket_point_2))  # -> flatten(Result)
connect_paths_through_bounds = GhPythonScript(geometries=merge_2, surf=surf_3, extended_surf=extended_surf_2, overspray_dist=overspray_distance)  # -> out, connected_path; inputs geometries: list of GeometryBase, surf: Brep, extended_surf: Surface
# ---------- connect_paths_through_bounds: Python ----------
from acorn_spraying.path_generation import connect_paths_through_bounds

connected_path = connect_paths_through_bounds(geometries, surf, 
    extended_surf, overspray_dist)
# ---------- end connect_paths_through_bounds ----------
paths = Geometry(connect_paths_through_bounds.connected_path)

# ----
spray_diameter_2 = Number(spray_diameter)
path1 = Curve(path_1)
path2 = Curve(path_2)
# Visualise spraying
surf_4 = Surface(surface)
entwine = Entwine(Branch00=path1, Branch01=path2, FlattenInputs=True)  # -> simplify(Result)
expression_2 = Expression(x=spray_diameter_2, Expression="x * 0.1")
divlength = DivideLength(Curve=entwine, Length=expression_2)  # -> Points, Tangents, Parameters
srf_cp = SurfaceClosestPoint(Point=divlength.Points, Surface=surf_4)  # -> Point, UVPoint, Distance
expression_3 = Expression(x=spray_diameter_2, Expression="x / 2")
evalsrf = EvaluateSurface(Surface=surf_4, Point=srf_cp.UVPoint)  # -> Point, Normal, UDirection, VDirection, Frame
circle = CircleCNR(Center=divlength.Points, Normal=evalsrf.Normal, Radius=expression_3)
bang = ExplodeTree(Data=simplify(circle))  # -> Branch0, Branch1
preview = CustomPreview(
    Geometry=bang.Branch0,
    Material={diffuse=RGB(221, 160, 221), emission=RGB(66, 48, 66), shine=0.5, specular=RGB(255, 255, 255), transparency=0})
preview_2 = CustomPreview(
    Geometry=bang.Branch1,
    Material={diffuse=RGB(221, 160, 221), emission=RGB(66, 48, 66), shine=0.5, specular=RGB(255, 255, 255), transparency=0})

# ---- group: Separate paths
surf_5 = Surface(surface)
spray_diameter_3 = Number(spray_diameter)
extended_surf_3 = Surface(extended_surf)
split_path_on_off_surf = GhPythonScript(path=paths, surf=surf_5, extended_surf=extended_surf_3, spray_diameter=spray_diameter_3)  # -> paths, on_surface; inputs path: Curve, surf: Brep, extended_surf: Surface
# ---------- split_path_on_off_surf: Python ----------
from acorn_spraying.path_processing import split_path_on_off_surf

paths, on_surface = split_path_on_off_surf(path, surf, extended_surf, spray_diameter)
# ---------- end split_path_on_off_surf ----------
on_surface = Boolean(flatten(split_path_on_off_surf.on_surface))
paths_2 = Geometry(flatten(split_path_on_off_surf.paths))

# ----
on_surface_2 = Boolean(on_surface)
paths_3 = Geometry(paths_2)
# Visualise waste
surf_6 = Surface(surface)
wires = BrepWireframe(Brep=surf_6, Density=-1)
dispatch = Dispatch(List=paths_3, DispatchPattern=on_surface_2)  # -> ListA, ListB
join = JoinCurves(Curves=wires, Preserve=False)
len = Length(Curve=flatten(dispatch.ListB))
len_2 = Length(Curve=flatten(paths_3))
trim_curve_boundary = GhPythonScript(curve=dispatch.ListA, bounds=join)  # -> inside_curves, outside_curves; inputs curve: Curve, bounds: Curve
# ---------- trim_curve_boundary: Python ----------
from acorn_spraying.misc import trim_curve_boundary

inside_curves, outside_curves = trim_curve_boundary(curve, bounds)
# ---------- end trim_curve_boundary ----------
len_3 = Length(Curve=flatten(trim_curve_boundary.outside_curves))
ma = MassAddition(Input=len_3)  # -> Result, PartialResults
ma_2 = MassAddition(Input=len_2)  # -> Result, PartialResults
area = Area(Geometry=surf_6)  # -> Area, Centroid
ma_3 = MassAddition(Input=len)  # -> Result, PartialResults
concat = Concatenate(
    FragmentA="Off-surface waste: ",
    FragmentB=ma_3.Result,
    FragmentC="On-surface waste: ",
    FragmentD=ma.Result,
    FragmentE="Total path length: ",
    FragmentF=ma_2.Result)
preview_3 = CustomPreview(Geometry=flatten(trim_curve_boundary.outside_curves), Material=ColourSwatch(SwatchColor=RGB(7, 49, 235)))
tag_2 = TextTag(Location=area.Centroid, Text=concat)
preview_4 = CustomPreview(Geometry=dispatch.ListB, Material=ColourSwatch(SwatchColor=RGB(235, 7, 7)))

# ---- group: Tool creation
spray_diameter_4 = Number(spray_diameter)
spray_distance_2 = Number(spray_distance)
pt = ConstructPoint(XCoordinate=0, YCoordinate=0, ZCoordinate="30")
X = UnitX(Factor="100")
pt_2 = ConstructPoint(XCoordinate=spray_distance_2, YCoordinate=0, ZCoordinate="30")
yz_2 = YZPlane(Origin=pt)
move = Move(Geometry=yz_2, Motion=X)  # -> Geometry, Transform
expression_4 = Expression(x=spray_diameter_4, Expression="x/2")
yz_3 = YZPlane(Origin=pt_2)
cir = Circle(Plane=move.Geometry, Radius="30")
cir_2 = Circle(Plane=yz_3, Radius=expression_4)
cyl = Cylinder(Base=yz_2, Radius="30", Length="100")
loft = Loft(Curves=[cir_2, cir], Options={Adjust=False, Closed=False, LoftEnds=0, LoftSimp=0, LoftType=0, Rebuild=10, Refit=0.01})
cap = CapHoles(Brep=[loft, cyl])
tool_geometry = Geometry(cap)
tool_frame = Plane(yz_3)

# ---- group: Table reference point
table_reference_point_3 = Point(table_reference_point_2)
panel = Panel("tableRef")
reference = CreateReference(
    Alias=panel,
    Frame=table_reference_point_3,
    _0_0=panel,
    _1_0=table_reference_point_3,
    Mode=0,
    RunInBackground=False,
    nickName="Reference")
tablereference = TableReference(reference, isNickNameImplied=False)

# ---- group: Sprayer tool
# Settings and reference
swatch = ColourSwatch(SwatchColor=RGBA(189, 189, 189, 100))
# Define robot
xy = XYPlane(Origin=Point(0, 0, 0))
panel_2 = Panel("flashlight")
tool = Tool(
    Alias=panel_2,
    Frame=xy,
    Object_Body=tool_geometry,
    Object_Color=swatch,
    ToolFrame=tool_frame,
    _0_0=panel_2,
    _1_0=xy,
    _2_0=tool_geometry,
    _3_0=swatch,
    _6_0=tool_frame,
    Mode=0,
    RunInBackground=False,
    nickName="Tool")

# ---- group: Robot
xy_2 = XYPlane(Origin=Point(0, 0, 0))
panel_3 = Panel("baseRobot")
robot = Robot(
    Alias=panel_3,
    Location=xy_2,
    _0_0=panel_3,
    _1_0=xy_2,
    Mode=0,
    RunInBackground=False,
    catalogItem="Mechanism,ce850552-3091-4db7-93ac-81867ea54116",
    nickName="⧉ Robot")
panel_4 = Panel("robot")
attach = Attach(
    Alias=panel_4,
    Parent=robot,
    Child=tool,
    IsEndEffector=True,
    InWorld=True,
    _0_0=panel_4,
    _1_0=robot,
    _2_0=tool,
    Mode=0,
    RunInBackground=False,
    nickName="Attach")
robot_2 = Robot(attach, isNickNameImplied=True)

# ---- group: Allow target rotation around Z axis
panel_5 = Panel("0")
panel_6 = Panel("2*Pi")
constraints = TargetConstraints(
    RotationAxis={halEnum=2, halEnumType="HAL.Spatial.Axis"},
    MinRotationRad=panel_5,
    MaxRotationRad=panel_6,
    _2_0=panel_5,
    _3_0=panel_6,
    Mode=0,
    RunInBackground=False,
    nickName="Constraints")
robot_3 = Robot(robot_2, isNickNameImplied=True)
kinematics = KinematicSettings(
    Mechanism=robot_3,
    TargetConstraints=constraints,
    _1_0=robot_3,
    _3_0=constraints,
    Mode=0,
    RunInBackground=False,
    nickName="Kinematics")

# ---- group: Spray settings
on_surface_3 = Boolean(on_surface)
spray_speed_off_surface = Number(spray_speed_off_surf)
spray_blend_dist_2 = Number(spray_blend_dist)
spray_speed_on_surface = Number(spray_speed_on_surf)
spray_blend_angle_2 = Number(spray_blend_angle)
panel_7 = Panel("speedOffSurf")
panel_8 = Panel("speedOnSurf")
speed = SpeedSettings(
    Alias=panel_7,
    PositionMmS=spray_speed_off_surface,
    _0_0=panel_7,
    _1_0=spray_speed_off_surface,
    Mode=0,
    RunInBackground=False,
    nickName="Speed")
speed_2 = SpeedSettings(
    Alias=panel_8,
    PositionMmS=spray_speed_on_surface,
    _0_0=panel_8,
    _1_0=spray_speed_on_surface,
    Mode=0,
    RunInBackground=False,
    nickName="Speed")
p_n_c = PickNChoose(Pattern=graft(on_surface_3), Stream0="sprayOffSet", Stream1="sprayOnSet")
rad_2 = Radians(Degrees=spray_blend_angle_2)
panel_9 = Panel("sprayBlend")
blend = BlendSettings(
    Alias=panel_9,
    PositionMm=spray_blend_dist_2,
    OrientationRad=rad_2,
    _0_0=panel_9,
    _1_0=spray_blend_dist_2,
    _2_0=rad_2,
    Mode=0,
    RunInBackground=False,
    nickName="Blend")
p_n_c_2 = PickNChoose(Pattern=graft(on_surface_3), Stream0=speed, Stream1=speed_2)
path_mapper = PathMapper(p_n_c, source="{a;b}", target="{a}")
path_mapper_2 = PathMapper(p_n_c_2, source="{a;b}", target="{a}")
motionsettings = MotionSettings(
    Alias=path_mapper,
    Space={halEnum=0, halEnumType="HAL.Motion.Settings.MotionSpace"},
    Speed=path_mapper_2,
    Blend=blend,
    Kinematics=kinematics,
    _0_0=path_mapper,
    _2_0=path_mapper_2,
    _4_0=blend,
    _5_0=kinematics,
    Mode=0,
    RunInBackground=False,
    nickName="MotionSettings")

# ---- group: Move to waste basket
waste_basket_position = Point(waste_basket_point)
tablereference_2 = TableReference(tablereference, isNickNameImplied=True)
pflip = FlipPlane(Plane=waste_basket_position, ReverseX=False, ReverseY=False, SwapAxes=True)
panel_10 = Panel("wasteMoSet")
motionsettings_2 = MotionSettings(
    Alias=panel_10,
    Space={halEnum=1, halEnumType="HAL.Motion.Settings.MotionSpace"},
    Kinematics=kinematics,
    _0_0=panel_10,
    _5_0=kinematics,
    Mode=0,
    RunInBackground=False,
    nickName="MotionSettings")
panel_11 = Panel("wasteT")
target = Target(
    Object_Alias=panel_11,
    Object_Frame=pflip,
    Reference=tablereference_2,
    InWorld=False,
    _0_0=panel_11,
    _1_0=pflip,
    _2_0=tablereference_2,
    Mode=0,
    RunInBackground=False,
    nickName="Target")
panel_12 = Panel("goWaste")
move_2 = Move(
    Alias=panel_12,
    Object_Target=target,
    Object_MotionSettings=motionsettings_2,
    _0_0=panel_12,
    _1_0=target,
    _2_0=motionsettings_2,
    Mode=0,
    RunInBackground=False,
    nickName="Move")

# ---- group: Move home
j1 = Slider(0, range=-180..180)
j2 = Slider(0, range=-70..85)
j3 = Slider(0, range=-28..110)
j4 = Slider(0, range=-300..300)
j5 = Slider(30, range=-120..120)
j6 = Slider(0, range=-300..300)
# Procedures
robot_4 = Robot(robot_2, isNickNameImplied=True)
angle_3 = Angle(j1, isNickNameImplied=False, locked=False, unit="deg")
angle_4 = Angle(j2, isNickNameImplied=False, locked=False, unit="deg")
angle_5 = Angle(j3, isNickNameImplied=False, locked=False, unit="deg")
angle_6 = Angle(j4, isNickNameImplied=False, locked=False, unit="deg")
angle_7 = Angle(j5, isNickNameImplied=False, locked=False, unit="deg")
angle_8 = Angle(j6, isNickNameImplied=False, locked=False, unit="deg")
angle_rad = Angle(angle_3, isNickNameImplied=True, locked=True, unit="rad")
angle_rad_2 = Angle(angle_4, isNickNameImplied=True, locked=True, unit="rad")
angle_rad_3 = Angle(angle_5, isNickNameImplied=True, locked=True, unit="rad")
angle_rad_4 = Angle(angle_6, isNickNameImplied=True, locked=True, unit="rad")
angle_rad_5 = Angle(angle_7, isNickNameImplied=True, locked=True, unit="rad")
angle_rad_6 = Angle(angle_8, isNickNameImplied=True, locked=True, unit="rad")
position = Merge(
    Data1=flatten(angle_rad),
    Data2=flatten(angle_rad_2),
    Data3=flatten(angle_rad_3),
    Data4=flatten(angle_rad_4),
    Data5=flatten(angle_rad_5),
    Data6=flatten(angle_rad_6))
panel_13 = Panel("homeMoSet")
motionsettings_3 = MotionSettings(
    Alias=panel_13,
    Space={halEnum=1, halEnumType="HAL.Motion.Settings.MotionSpace"},
    _0_0=panel_13,
    Mode=0,
    RunInBackground=False,
    nickName="MotionSettings")
panel_14 = Panel("homeT")
target_2 = Target(
    Alias=panel_14,
    Mechanism=robot_4,
    Object_Position=position,
    _0_0=panel_14,
    _1_0=robot_4,
    _2_0=position,
    Mode=0,
    RunInBackground=False,
    nickName="Target")
panel_15 = Panel("goHome")
move_3 = Move(
    Alias=panel_15,
    Object_Target=target_2,
    Object_MotionSettings=motionsettings_3,
    _0_0=panel_15,
    _1_0=target_2,
    _2_0=motionsettings_3,
    Mode=0,
    RunInBackground=False,
    nickName="Move")

# ---- group: Wait
wait_time_2 = Number(wait_time)
panel_16 = Panel("wait")
waittime = WaitTime(
    Alias=panel_16,
    DurationS=wait_time_2,
    _0_0=panel_16,
    _1_0=wait_time_2,
    Mode=0,
    RunInBackground=False,
    nickName="WaitTime")

# ----
panel_17 = Panel("goSpray")

# ---- group: Spray
target_distance_filter = Number(target_dist_filter)
tablereference_3 = TableReference(tablereference, isNickNameImplied=True)
surf_7 = Geometry(surface)
paths_4 = Curve(simplify(paths_2))
target_3 = Target(
    Alias="Curve",
    Curve=paths_4,
    Discretization={halEnum=1, halEnumType="HAL.McNeel.RhinoCommon5.Spatial.CurveDiscretization"},
    ToleranceMm=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,
    Reference=tablereference_3,
    InWorld=False,
    _1_0=paths_4,
    _4_0=tablereference_3,
    Mode=0,
    RunInBackground=False,
    nickName="Target")  # -> simplify(Object_Target), Trace
lng = ListLength(List=target_3.Object_Target)
filter = TargetFilter(
    Object_Target=flatten(target_3.Object_Target),
    PositionMm=target_distance_filter,
    OrientationRad=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,
    _0_0=target_3,
    _1_0=target_distance_filter,
    Mode=0,
    RunInBackground=False,
    nickName="Filter")  # -> Object_Remaining, Object_Discarded, Object_Mask
evalsrf_2 = EvaluateSurface(Surface=surf_7, Point="{0.5, 0.5, 0}")  # -> Point, Normal, UDirection, VDirection, Frame
Z = UnitZ(Factor=1)
repeat = RepeatData(Data=graft(motionsettings), Length=graft(lng))  # -> flatten(Data)
dprod = DotProduct(VectorA=Z, VectorB=evalsrf_2.Normal, Unitize=False)
cull = CullPattern(List=repeat, CullPattern=filter.Object_Mask)
larger = LargerThan(FirstNumber=dprod, SecondNumber=0)  # -> LargerThan, OrEqualTo
normal = Normal(
    Target=flatten(filter.Object_Remaining),
    Guide=flatten(surf_7),
    Axis={halEnum=2, halEnumType="HAL.Spatial.Axis"},
    Flip=larger.LargerThan,
    Project=False,
    _0_0=filter,
    _2_0=surf_7,
    _4_0=larger,
    Mode=0,
    RunInBackground=False,
    nickName="Normal")  # -> simplify(Target), Object_OnGuide, Object_Normal
target_4 = TargetProperties(Target=normal.Target, _0_0=normal, Mode=0, RunInBackground=False, nickName="Target")  # -> Alias, Object_Joint, WayFrame, EndFrame, Reference, IsArc
vec2pt = Vector2Pt(PointA="{0,0,0}", PointB=target_4.EndFrame, Unitize=True)  # -> Vector, Length
parallel = Parallel(
    Target=normal.Target,
    Direction=vec2pt.Vector,
    Axis={halEnum=1, halEnumType="HAL.Spatial.Axis"},
    Flip=False,
    Project=True,
    _0_0=normal,
    _2_0=vec2pt,
    Mode=0,
    RunInBackground=False,
    nickName="Parallel")  # -> flatten(Target)
move_4 = Move(
    Alias=panel_17,
    Object_Target=parallel,
    Object_MotionSettings=cull,
    _0_0=panel_17,
    _1_0=parallel,
    _2_0=cull,
    Mode=0,
    RunInBackground=False,
    nickName="Move")  # -> simplify(Action)

# ----
merge_3 = Merge(
    Data1=flatten(move_3),
    Data2=flatten(move_2),
    Data3=flatten(waittime),
    Data4=flatten(move_4),
    Data5=flatten(waittime),
    Data6=flatten(move_3))
panel_18 = Panel(merge_3)
panel_19 = Panel("SprayMod")
combine = CombineActions(
    Alias=panel_19,
    Object_Combined=merge_3,
    Compact=False,
    _0_0=panel_19,
    _1_0=merge_3,
    Mode=0,
    RunInBackground=False,
    nickName="Combine")

# ---- group: Solve robot
controller = ExecutionControl(Loop=False, TimeRatio=1)
solve = BooleanToggle(False)
export = BooleanToggle(False)
export_directory_2 = Text(export_directory)
# Solver
robot_5 = Robot(robot_2, isNickNameImplied=True)
panel_20 = Panel("controller")
controller_2 = Controller(
    Alias=panel_20,
    Object_Mechanism=robot_5,
    Object_Procedure=combine,
    _0_0=panel_20,
    _2_0=robot_5,
    _3_0=combine,
    Mode=0,
    RunInBackground=False,
    catalogItem="Controller,7ab5730a-2de3-481a-aaee-af392f24ce56",
    nickName="⧉ Controller")
solver = ProcedureSolver(Controller=controller_2, Solve=solve, Mode=0, RunInBackground=True)  # -> Solution, Object_Solved, Notification
execute = Execute(
    ExecutionControl=controller,
    Solution=solver.Solution,
    displayEnvironment=True,
    displayMechanisms=True,
    displayTrace=True)
export_2 = ExportProcedure(
    Controller=controller_2,
    Solution=solver.Solution,
    Destination=export_directory_2,
    Export=export,
    _0_0=controller_2,
    _1_0=solver,
    _2_0=export_directory_2,
    _3_0=export,
    Mode=0,
    RunInBackground=True,
    nickName="Export")

# ----
file = ReadFile(File=export_2, PerLineParse=True)
panel_21 = Panel(export_2)
panel_22 = Panel(file)
